# Grasshopper definition gh-basic-contour.gh (Grasshopper 0.9.80)

# 1. Set one or more Breps
# 2. Adjust material thickness (in this case 3 mm)
# 3. Adjust spacing between contours (in this case 12 mm).
# This could match 3mm thickness to make stack of slices.
# 4. Bake Contours
number_slider = Slider(3, range=2..10)
spacing = Panel("12")
# Digital Fabrication Methods
# Basic Contour
# by RJ Duran (Critical Making Studio, Fall 2018)
# http://make.cmci.studio
brep = Brep(<brep referenced from the Rhino model>)
thickness = Panel("3")
contour = Contour(Shape=brep, Point=Point(0, 0, 0), Direction=Vector(0, 0, 1), Distance=spacing)
Z = UnitZ(Factor=thickness)

# ---- group: Surface
boundary = BoundarySurfaces(Edges=contour)

# ----
extr = Extrude(Base=boundary, Direction=Z)
