# Grasshopper definition gh-layout-contours-grid.gh (Grasshopper 0.9.80)

thickness = Panel("0.25")
brep = Brep(<brep referenced from the Rhino model>)
contour = Contour(Shape=brep, Point=Point(0, 0, 0), Direction=Vector(0, 0, 1), Distance=thickness)

# ---- group: Sliced Result
boundary = BoundarySurfaces(Edges=contour)
Z = UnitZ(Factor=thickness)
extr = Extrude(Base=boundary, Direction=Z)

# ---- group: Group Contours
group = Group(Objects=contour)

# ----
bbox = BoundingBox(Content=group, Plane=PlaneXY(0, 0, 0))  # -> Box, Box_2
debox = DeconstructBox(Box=bbox.Box)  # -> Plane, X, Y, Z

# ---- group: # Groups
lng = ListLength(List=flatten(group))

# ----
start_series = Panel("0")
num = Number(flatten(debox.X))
x_offset = Panel("20")

# ---- group: Layers
int = Integer(lng)
concat = Concatenate(FragmentA=int, FragmentB=" layers")
pt = ConstructPoint(XCoordinate=Slider(0, range=-20..20), YCoordinate=Slider(-15, range=-20..20), ZCoordinate=0)
tag = TextTag3D(
    Location=pt,
    Text=concat,
    Size=Slider(3, range=1..10),
    Colour=ColourSwatch(SwatchColor=RGB(255, 255, 255)),
    Justification=7)

# ----
series = Series(Start=0, Step=thickness, Count=lng)
series_2 = Series(Start=start_series, Step=1, Count=lng)
addition = Addition(A=num, B=x_offset)
pt_2 = ConstructPoint(XCoordinate=0, YCoordinate=0, ZCoordinate=series)
int_2 = Integer(series_2)
ma = MassAddition(Input=addition)  # -> Result, PartialResults
pt_3 = ConstructPoint(XCoordinate=ma.PartialResults, YCoordinate=0, ZCoordinate=0)

# ---- group: Offset Vector
vec2pt = Vector2Pt(PointA=pt_2, PointB=pt_3, Unitize=False)  # -> Vector, Length

# ----
move = Move(Geometry=flatten(group), Motion=vec2pt.Vector)  # -> Geometry, Transform

# ---- group: Project to CPlane
project = Project(Geometry=move.Geometry, Plane=PlaneXY(0, 0, 0))  # -> Geometry, Transform

# ----
number_slider = Slider(16, range=1..20)
sqgrid = Square(Plane=PlaneXY(0, 0, 0), Size=Slider(100, range=10..100), ExtentX=Slider(4, range=1..100), ExtentY="1")  # -> Cells, Points
bbox_2 = BoundingBox(Content=project.Geometry, Plane=PlaneXY(0, 0, 0))  # -> Box, Box_2
flip = FlipMatrix(Data=sqgrid.Points)  # -> flatten(Data)
rec = Rectangle(bbox_2.Box)
recgrid = Rectangular(
    Plane=PlaneXY(0, 0, 0),
    SizeX=number_slider,
    SizeY=number_slider,
    ExtentX=Slider(8, range=1..10),
    ExtentY=Slider(7, range=1..10))  # -> Cells, Points
explode = Explode(Curve=rec, Recursive=True)  # -> Segments, Vertices
pt_4 = Point(flip)
flatten = FlattenTree(Tree=recgrid.Cells, Path="{0}")
item = ListItem(List=explode.Vertices, Index=Slider(3, range=0..5), Wrap=True)
lng_2 = ListLength(List=rec)
split = SplitList(List=flatten, Index=lng_2)  # -> ListA, ListB
flatten_2 = FlattenTree(Tree=item, Path="{0}")

# ---- group: Inside Offset
offset = Offset(Curve=rec, Distance=5, Plane=PlaneXY(0, 0, 0), Corners=1)

# ---- group: Outside Offset
offset_2 = Offset(Curve=rec, Distance=10, Plane=PlaneXY(0, 0, 0), Corners=1)

# ----
explode_2 = Explode(Curve=split.ListA, Recursive=True)  # -> Segments, Vertices
label_prefix = Panel("A-")
explode_3 = Explode(Curve=offset, Recursive=True)  # -> Segments, Vertices

# ---- group: Curve Bounds
crv = Curve(rec)

# ----
concat_2 = Concatenate(FragmentA=label_prefix, FragmentB=int_2)
item_2 = ListItem(List=explode_2.Vertices, Index=3, Wrap=True)
area = Area(Geometry=offset)  # -> Area, Centroid

# ---- group: Select First Point
item_3 = ListItem(List=explode_3.Vertices, Index=0, Wrap=True)

# ---- group: Curves
geo = Geometry([crv, project.Geometry])

# ---- group: Slice Corner Point
pt_5 = Point(flatten_2)

# ----
flatten_3 = FlattenTree(Tree=item_2, Path="{0}")

# ---- group: Draw Label
tag_2 = TextTag3D(Location=simplify(area.Centroid), Text=graft(concat_2), Size=Slider(1.082, range=0..10), Justification=5)

# ---- group: Grid Cell Corner Point
pt_6 = Point(flatten_3)

# ----
points = PointList(Points=pt_6, Size=Slider(1.68, range=0..10))
vec2pt_2 = Vector2Pt(PointA=pt_5, PointB=pt_6, Unitize=False)  # -> Vector, Length
ln = Line(StartPoint=pt_5, EndPoint=pt_6)
move_2 = Move(Geometry=geo, Motion=vec2pt_2.Vector)  # -> Geometry, Transform
bang = ExplodeTree(Data=move_2.Geometry)  # -> Branch0, Branch1
graft = GraftTree(Tree=bang.Branch1, IncludeEmptyLists=True, IncludeNullItems=True)
area_2 = Area(Geometry=bang.Branch1)  # -> Area, Centroid
ungroup = Ungroup(Group=bang.Branch0)  # -> simplify(Objects)
simplify = SimplifyTree(Tree=graft, Front=False)

# ---- group: Slice Center Point
pt_7 = Point(area_2.Centroid)

# ---- group: Draw Label at Slice Center Point
tag_3 = TextTag3D(Location=simplify(pt_7), Text=concat_2, Size=Slider(0.909, range=0..10), Justification=5)

# ----
crv_2 = Curve([simplify, ungroup])
group_2 = Group(Objects=crv_2)
