# Grasshopper definition gh-layout-contours-linear.gh (Grasshopper 1.0.7)

thickness = Panel("3")
brep = Brep(<brep referenced from the Rhino model>)
contour = Contour(Shape=brep, Point=Point(0, 0, 0), Direction=Vector(0, 0, 1), Distance=thickness)

# ---- group: Sliced Result
boundary = BoundarySurfaces(Edges=contour)
Z = UnitZ(Factor=thickness)
extr = Extrude(Base=boundary, Direction=Z)

# ---- group: Group Contours
group = Group(Objects=contour)

# ----
bbox = BoundingBox(Content=group, Plane=PlaneXY(0, 0, 0))  # -> Box, Box_2
debox = DeconstructBox(Box=bbox.Box)  # -> Plane, X, Y, Z

# ---- group: # Groups
lng = ListLength(List=flatten(group))

# ----
start_series = Panel("1")
num = Number(flatten(debox.X))
x_offset = Panel("100")
series = Series(Start=0, Step=thickness, Count=lng)
series_2 = Series(Start=start_series, Step=1, Count=lng)
addition = Addition(A=num, B=x_offset)
pt = ConstructPoint(XCoordinate=0, YCoordinate=0, ZCoordinate=series)
int = Integer(series_2)
ma = MassAddition(Input=addition)  # -> Result, PartialResults
pt_2 = ConstructPoint(XCoordinate=ma.PartialResults, YCoordinate=0, ZCoordinate=0)

# ---- group: Offset Vector
vec2pt = Vector2Pt(PointA=pt, PointB=pt_2, Unitize=False)  # -> Vector, Length

# ----
move = Move(Geometry=flatten(group), Motion=vec2pt.Vector)  # -> Geometry, Transform

# ---- group: Project to CPlane
project = Project(Geometry=move.Geometry, Plane=PlaneXY(0, 0, 0))  # -> Geometry, Transform

# ----
bbox_2 = BoundingBox(Content=project.Geometry, Plane=PlaneXY(0, 0, 0))  # -> Box, Box_2
rec = Rectangle(bbox_2.Box)

# ---- group: Inside Offset
offset = Offset(Curve=rec, Distance=5, Plane=PlaneXY(0, 0, 0), Corners=1)

# ---- group: Outside Offset
offset_2 = Offset(Curve=rec, Distance=10, Plane=PlaneXY(0, 0, 0), Corners=1)

# ----
label_prefix = Panel("A-")
explode = Explode(Curve=offset, Recursive=True)  # -> Segments, Vertices
concat = Concatenate(FragmentA=label_prefix, FragmentB=int)
area = Area(Geometry=offset)  # -> Area, Centroid

# ---- group: Select First Point
item = ListItem(List=explode.Vertices, Index=0, Wrap=True)

# ---- group: Draw Label
tag = TextTag3D(Location=simplify(area.Centroid), Text=graft(concat), Size=Slider(3, range=0..10), Justification=5)
