# Grasshopper definition gh-layout-vessel-contours.gh (Grasshopper 1.0.7)

thickness = Panel("0.25")
brep = Brep(<brep referenced from the Rhino model>)
contour = Contour(Shape=brep, Point=Point(0, 0, 0), Direction=Vector(0, 0, 1), Distance=thickness)

# ---- group: Sliced Result
boundary = BoundarySurfaces(Edges=contour)
Z = UnitZ(Factor=thickness)
extr = Extrude(Base=boundary, Direction=Z)

# ---- group: Group Contours
group = Group(Objects=contour)

# ----
bbox = BoundingBox(Content=group, Plane=PlaneXY(0, 0, 0))  # -> Box, Box_2
offset = Slider(8, range=5..10)
debox = DeconstructBox(Box=bbox.Box)  # -> Plane, X, Y, Z

# ---- group: # Groups
lng = ListLength(List=flatten(group))

# ----
start_series = Panel("1")
num = Number(flatten(debox.X))
x_offset = Panel("5")
series = Series(Start=0, Step=thickness, Count=lng)
series_2 = Series(Start=start_series, Step=1, Count=lng)
addition = Addition(A=num, B=offset)
pt = ConstructPoint(XCoordinate=0, YCoordinate=0, ZCoordinate=series)
int = Integer(series_2)
ma = MassAddition(Input=addition)  # -> Result, PartialResults
pt_2 = ConstructPoint(XCoordinate=ma.PartialResults, YCoordinate=0, ZCoordinate=0)

# ---- group: Offset Vector
vec2pt = Vector2Pt(PointA=pt, PointB=pt_2, Unitize=False)  # -> Vector, Length

# ----
move = Move(Geometry=flatten(group), Motion=vec2pt.Vector)  # -> Geometry, Transform

# ---- group: Project to CPlane
project = Project(Geometry=move.Geometry, Plane=PlaneXY(0, 0, 0))  # -> Geometry, Transform

# ----
offset_2 = Slider(2, range=1..10)
bbox_2 = BoundingBox(Content=project.Geometry, Plane=PlaneXY(0, 0, 0))  # -> Box, Box_2
rec = Rectangle(bbox_2.Box)

# ---- group: Material Bounds
offset_3 = Offset(Curve=rec, Distance=offset_2, Plane=PlaneXY(0, 0, 0), Corners=1)

# ----
md_slider = MDSlider(
    SliderMode=0,
    slider_value=Point(0.5001816168, 0.09939537979, 0.5),
    x_domain=Domain(0, 1),
    y_domain=Domain(0, 1),
    z_domain=Domain(0, 1))

# ---- group: Adjust Label Position
explode = Explode(Curve=offset_3, Recursive=True)  # -> Segments, Vertices
list_item = ListItem(List=explode.Segments, Index=0, Wrap=True)
item = ListItem(List=explode.Vertices, Index=0, Wrap=True)
length = Length(Curve=list_item)
multiplication = Multiplication(A=length, B=md_slider)
deconstruct = Deconstruct(Point=multiplication)  # -> XComponent, YComponent, ZComponent
vector_xyz = VectorXYZ(XComponent=deconstruct.XComponent, YComponent=deconstruct.YComponent, ZComponent=0)  # -> Vector, Length
move_2 = Move(Geometry=item, Motion=vector_xyz.Vector)  # -> Geometry, Transform

# ----
label_prefix = Panel("A-")
concat = Concatenate(FragmentA=label_prefix, FragmentB=int)

# ---- group: Draw Label
tag = TextTag3D(Location=simplify(move_2.Geometry), Text=graft(concat), Size=Slider(0.5, range=0..1), Justification=5)

# ---- group: BAKE
geometry = Geometry([project.Geometry, offset_3])
